vi "GET_INFORMATION_ANALOG.gvi"   [LabVIEW NXG]
inputs:
  "input 0": bool
outputs:
  "16-bit integer": i16[]
panel indicators:
  "error out": error
types:
  T1 = cluster{"sample rate": i32, "number of channels": i32, "bits per sample": i32}
diagram:
  w1 = T1 {"sample rate"=44100, "number of channels"=1, "bits per sample"=16}
  call "Sound Input Configure.gvi"(device ID=0, sound format=w1, sample mode=1, number of samples per channel=100000) -> (task ID=w2, error out=w3)
  call "Sound Input Stop.gvi"(task ID=w2, error in=w3) -> (task ID out=w4, error out=w5)
  call "Sound Input Start.gvi"(task ID=w4, error in=w5) -> (task ID out=w6, error out=w7)
  Logical And($"input 0", FALSE) -> w8
  while {
    call "Sound Input Read.gvi"(task ID=w6, error in=w7, number of samples per channel=10000, timeout=10) -> (task ID out=w9, data=w10, error out=w11)
    Array Index(array=w10) -> (out0[0]=w12)
    Property Node(instance in=w12) -> ("Y"=w13)
    To Word Integer(number=w13) -> w14
    $"16-bit integer" <- w14
    continue if w8
  }
  call "Sound Input Clear.gvi"(task ID=w9, error in=w11) -> (error out=w15)
  $"error out" <- w15
