vi "PulsModulate.gvi"   [LabVIEW NXG]
inputs:
  "input bit stream": i16[]
outputs:
  "[I,Q,I,Q,...]": i16[]
diagram:
  call "MT Generate PSK System Parameters(map).gvi"(PSK type="normal", samples per symbol=16, symbol values=[0, 1, 3, 2], differential PSK="disable") -> (PSK system parameters=w1, error out=w2)
  # TODO
  # -> find correct PSK system paratmers
  # -> number of samples per symbol ?!
  # -> construction of 16-bit output array
  #
  # -> AS ALWAYS
  # -> -> DATA SYNCHRONIZATION&QUEUING
  call "MT Modulate PSK.gvi"(input bit stream=$"input bit stream", PSK system parameters=w1, symbol rate=44100, error in=w2, reset?=TRUE, flush buffers?=FALSE) -> (output complex waveform=w3)
  Property Node(instance in=w3) -> ("Y"=w4)
  Complex To Real Imaginary(x + iy=w4) -> (x=w5, y=w6)
  To Word Integer(number=w5) -> w7
  To Word Integer(number=w6) -> w8
  s1 = 0  # shift register
  while {
    Increment(x=s1) -> w9: u32
    Array Index(array=w7) -> (out0[w9]=w10)
    Array Index(array=w8) -> (out0[w9]=w11)
    Build Array(w10, w11) -> w12
    $"[I,Q,I,Q,...]" <- w12
    next s1 = w9
    stop if FALSE
  }
