vi "Tx_AudioRead.gvi"   [LabVIEW NXG]
outputs:
  "data": i16[]
panel controls:
  "Information Souce - Audio File Path": path
  "Numeric": i16
diagram:
  Open Or Create Or Replace File(access (0:read/write)="read/write", file path (use dialog)=$"Information Souce - Audio File Path", operation (0:open)="open") -> (refnum out=w1)
  Get File Size(file=w1) -> (size (in bytes)=w2)
  Divide(x=w2, y=2) -> w3
  Read From Binary File(byte order="big-endian, network order", count=w3, data type=$Numeric, file (use dialog)=w1) -> (data=w4)
  $data <- w4
