vi "Tx_AudioRecording.gvi"   [LabVIEW NXG]
outputs:
  "Y": f64[]
panel indicators:
  "error out": error
types:
  T1 = cluster{"sample rate": i32, "number of channels": i32, "bits per sample": i32}
diagram:
  w1 = T1 {"sample rate"=44100, "number of channels"=1, "bits per sample"=16}
  call "Sound Input Configure.gvi"(device ID=0, sound format=w1, sample mode=1, number of samples per channel=100000) -> (task ID=w2, error out=w3)
  call "Sound Input Start.gvi"(task ID=w2, error in=w3) -> (task ID out=w4, error out=w5)
  call "Sound Input Read.gvi"(task ID=w4, error in=w5, number of samples per channel=10000, timeout=10) -> (task ID out=w6, data=w7, error out=w8)
  # ONLY ONE CHANNEL thus only idx 0
  Array Index(array=w7) -> (out0[0]=w9)
  Property Node(instance in=w9) -> ("Y"=w10)
  $Y <- w10
  call "Sound Input Clear.gvi"(task ID=w6, error in=w8) -> (error out=w11)
  $"error out" <- w11
