vi "Tx_main.gvi"   [LabVIEW NXG]
panel controls:
  "Source - Micro OR Audio-File": i32 = "Microphone"(0)
  "STOPS MICROPHONE RECORDING": bool
  "STOPS READING FROM AUDIO FILE": bool
  "Attached USRP": string = "NI2901Rx"
  "IQ rate": f64 = 200000
  "carrier frequency": f64 = 2450000000
panel indicators:
  "DO NOT REMOVE!!!": i32
  "Error OUTPUT": error
  "coerced IQ rate": f64
  "coerced carrier frequency": f64
  "coerced gain": f64
  "Puls Modulation Error": error
diagram:
  call "Tx_FormatBlock.gvi"()
  call "niUSRP Open Tx Session.gvi"(Device names=$"Attached USRP", Reset=TRUE) -> (Error Out=w1, Session handle=w2)
  call "niUSRP Configure Signal.gvi"(session handle=w2, IQ rate=$"IQ rate", carrier frequency=$"carrier frequency", gain=0, error in (no error)=w1, channel list="0") -> (session handle out=w3, coerced IQ rate=w4, coerced carrier frequency=w5, coerced gain=w6, Error Out=w7)
  case ($"Source - Micro OR Audio-File") {
    frame 0, Default {
      while {
        call "Tx_AudioRecording.gvi"() -> (Y=w10)
        call "PulsModulate.gvi"(input bit stream=w10) -> (Y=w11)
        call "niUSRP Write Tx Data (CDB).gvi"(session handle=w3, data=w11, timeout=100, end of data?=$"STOPS MICROPHONE RECORDING", error in (no error)=w7, channel list="0") -> (session handle out=w8, Error Out=w9)
        Logical Or(w9, $"STOPS MICROPHONE RECORDING") -> w12
        stop if w12
      }
    }
    frame 1 {
      while {
        call "Tx_AudioRead.gvi"() -> (data=w13)
        call "niUSRP Write Tx Data (I16).gvi"(session handle=w3, data=w13, timeout=10, error in (no error)=w7, channel list="0") -> (session handle out=w8, Error Out=w9)
        Logical Or(w9, $"STOPS READING FROM AUDIO FILE") -> w14
        stop if w14
      }
    }
  }
  call "niUSRP Clear Error.gvi"(session handle=w8, error in (no error)=w9) -> (session handle out=w15, Error Out=w16)
  call "niUSRP Reset.gvi"(session handle=w15, error in (no error)=w16) -> (session handle out=w17, Error Out=w18)
  call "niUSRP Close Session.gvi"(Handle in=w17, error in (no error)=w18) -> (Error Out=w19)
  $"Error OUTPUT" <- w19
  $"coerced IQ rate" <- w4
  $"coerced gain" <- w6
  $"coerced carrier frequency" <- w5
